# Grasshopper definition Snapshots-gh.gh (Grasshopper 1.0.7)
# Copyright: All rights reserved © 2018

msphere = MeshSphere(Base=PlaneXY(0, 0, 0), Radius=Slider(50, range=0..100), UCount=10, VCount=20)
demesh = DeconstructMesh(Mesh=msphere)  # -> Vertices, Faces, Colours, Normals

# ----
# Bake me!
conmesh = ConstructMesh(Vertices=demesh.Vertices, Faces=graft(demesh.Faces))  # -> flatten(Mesh)

# ----
# Input baked mesh
mesh = Mesh(flatten([<mesh referenced from the Rhino model> x200]))

# ---- group: Origins points ref
bbox = BoundingBox(Content=mesh, Plane=PlaneXY(0, 0, 0), UnionBox=False)  # -> Box, Box_2
area = Area(Geometry=bbox.Box)  # -> Area, Centroid

# ---- group: Vector Directions + Amplitude
facen = FaceNormals(Mesh=mesh)  # -> Centers, Normals
amp = Amplitude(Vector=flatten(facen.Normals), Amplitude=Slider(0, range=0..100))

# ----
brep = Brep([<brep referenced from the Rhino model> x400])
run = Button()
c_script = CSharpScript(guid=mesh)  # -> out, objRef; inputs guid: Guid
# ---------- c_script: C# ----------
    objRef = new Rhino.DocObjects.ObjRef(guid);
# ---------- end c_script ----------
# Internalize me!
pt = Point(flatten([Point(0, 0, 0), Point(0, 0, 0), Point(0, 0, 0), Point(0, 0, 0), Point(0, 0, 0), Point(0, 0, 0)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]))
c_script_2 = CSharpScript(objRefs=c_script.objRef, origins=pt, vectors=amp, run=run)  # -> out, movedObjs; inputs objRefs: list, origins: list, vectors: list
# ---------- c_script_2: C# ----------
    // Explicitly cast the inputRun to bool
    bool runScript = (bool) run;

    if (runScript)
    {
      var movedObjsList = new List<object>();

      for (int i = 0; i < objRefs.Count; i++)
      {
        var objRef = objRefs[i] as Rhino.DocObjects.ObjRef;

        if (objRef == null)
        {
          Print("Failed to cast object reference.");
          return;
        }

        var rhinoObject = objRef.Object();

        if (rhinoObject == null)
        {
          Print("Failed to extract RhinoObject from ObjRef.");
          return;
        }

        var originPt = (origins[i] as Point3d?) ?? Point3d.Unset;
        var vector = vectors[i] as Vector3d?;

        if (vector == null)
        {
          Print("Failed to cast vector.");
          return;
        }

        var newCoordinate = originPt + vector.Value;
        var transform = Transform.Translation(newCoordinate - rhinoObject.Geometry.GetBoundingBox(true).Center);

        RhinoDoc.ActiveDoc.Objects.Transform(objRef, transform, true);

        movedObjsList.Add(objRef.Curve());
      }

      movedObjs = "Script executed successfully. Press the button again to run.";
    }
    else
    {
      movedObjs = "Script not triggered. Press the button to run the script.";
    }
# ---------- end c_script_2 ----------
